# Grasshopper definition ACADIA_analysis.gh (Grasshopper 1.0.7)
# plug-ins: karambaGH

# INPUT GEOMETRY
crv = Curve([<curve referenced from the Rhino model> x45])

# ---- group: members
number_slider = Slider(44, range=0..44)
python = GhPythonScript(n=number_slider)  # -> rob_num; inputs n: Int32
# ---------- python: Python ----------
#Robot Order

order = [
2, #0
1, #1
2, #2
1, #3
2, #4
1, #5
2, #6
1, #7
2, #8
2, #9
1, #10
2, #11
2, #12
1, #13
2, #14
2, #15
1, #16
1, #17
2, #18
1, #19
2, #20
1, #21
2, #22
2, #23
2, #24
1, #25
2, #26
1, #27
2, #29
2, #28
1, #30
2, #31
1, #32
1, #33
1, #34
2, #33
2, #38
1, #36
1, #37
#done
2, #36
2, #37
2, #39
2, #41
2, #42
1, #43
]

rob_num = order[n]
# ---------- end python ----------
python_2 = GhPythonScript(n=number_slider)  # -> idx; inputs n: Int32
# ---------- python_2: Python ----------
idx = range(n+1)

print idx
# ---------- end python_2 ----------
panel = Panel(number_slider)
panel_2 = Panel(python)
data = Data(crv)
data_2 = Data(python_2)

# ---- group: nodes
pt = Point([<point referenced from the Rhino model> x17])
python_3 = GhPythonScript(n=number_slider)  # -> idx; inputs n: Int32
# ---------- python_3: Python ----------
sphere_order = {
0: 2,
1: 3,
2: 4,
3: 4,
4: 4,
5: 4,
6: 5,
7: 5,
8: 5,
9: 6,
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}

idx = range(sphere_order[n])

print idx
# ---------- end python_3 ----------
data_3 = Data(pt)
data_4 = Data(python_3)

# ----
num = Number()

# ----
# INPUT PARAMETERS
# can update placement plane location manually during path planning or use default "place_far" value
panel_3 = Panel("C:/Users/Edvard/Documents/GitHub/workshop_princeton_2021/ACADIA/input_data/")
panel_4 = Panel("C:/Users/Edvard/Documents/GitHub/workshop_princeton_2021/ACADIA/input_data/")
python_4 = GhPythonScript(path=panel_4, filename="member_rotations.json", read_data=Toggle(True))  # -> rotations
# ---------- python_4: Python ----------
import os
from compas_fab.utilities import read_data_from_json
from compas_fab.robots import Configuration

if read_data:
    data = read_data_from_json(os.path.join(path, filename))
    
    
print len(data)
print data
print data['member_29']

rotations = []
for i in range(len(data)):
    rotations.append(data['member_{}'.format(i)])

print rotations
# ---------- end python_4 ----------
python_5 = GhPythonScript(path=panel_3, filename="input_params.json", read_data=Toggle(True))  # -> node_diameter, member_offset, cross_section, place_close, place_far
# ---------- python_5: Python ----------
import os
from compas_fab.utilities import read_data_from_json

if read_data:
    data = read_data_from_json(os.path.join(path, filename))

print data

node_diameter = data['node_diameter']
member_offset = data['member_dist_from_node']
cross_section = data['cross_section_dim']
place_far = data['offset_place_far']
place_close = data['offset_place_close']
# ---------- end python_5 ----------
num_2 = Number(python_5.node_diameter)
num_3 = Number(python_5.member_offset)
num_4 = Number(python_5.cross_section)
num_5 = Number(python_5.place_close)
data_5 = Data(python_4)
num_6 = Number(num)

# ---- group: cross-section
# 1 3/16" (30.16mm) section.
# this dist is to corner
panel_5 = Panel(num_4)
division = Division(A=panel_5, B="sqrt(2)")
polygon = Polygon(Plane=PlaneXY(0, 0, 0), Radius=division, Segments="4", FilletRadius=0)  # -> Polygon, Length
rotate = Rotate(Geometry=polygon.Polygon, Angle=degrees("45"), Plane=PlaneXY(0, 0, 0))  # -> Geometry, Transform
crv_2 = Curve(rotate.Geometry)

# ----
num_7 = Number(python_5.place_far)

# ---- group: current member curves
data_6 = Data(data_2)
data_7 = Data(data)
item = ListItem(List=data_7, Index=data_6, Wrap=True)
crv_3 = Curve(item)

# ---- group: member info
len = Length(Curve=crv_3)
midpt = CurveMiddle(Curve=crv_3)
panel_6 = Panel(num_3)
panel_7 = Panel(num_2)
pl = PlaneNormal(Origin=midpt, ZAxis=crv_3)
python_6 = GhPythonScript(radius=panel_7, offset=panel_6, len=len)  # -> z_factor; inputs len: list
# ---------- python_6: Python ----------
len_reduce = (radius + offset)*2

z_factor = [(l - len_reduce)/l for l in len]
# ---------- end python_6 ----------

# ---- group: member meshes
pframes = PerpFrames(Curve=crv_3, Count=1, Align=True)  # -> Frames, Parameters
crv_4 = Curve(crv_2)
orient = Orient(Geometry=crv_4, Source=PlaneXY(0, 0, 0), Target=simplify(pframes.Frames))  # -> Geometry, Transform
swp1 = Sweep1(Rail=graft(crv_3), Sections=orient.Geometry, Miter=1)

# ---- group: member rotations about axis
data_8 = Data(data_5)
data_9 = Data(data_2)
item_2 = ListItem(List=data_8, Index=data_9, Wrap=True)
panel_8 = Panel(item_2)

# ---- group: nodes
data_10 = Data(data_3)
data_11 = Data(data_4)
panel_9 = Panel(num_2)
item_3 = ListItem(List=data_10, Index=data_11, Wrap=True)
sph = Sphere(Base=item_3, Radius=panel_9)

# ----
panel_10 = Panel("""3
39
3""")
crv_5 = Curve(crv)
partition = PartitionList(List=crv_5, Size=panel_10)  # -> simplify(Chunks)

# ----
# STRUCTURE AT CURRENT STAGE OF CONSTRUCTION
pln = Plane(pl)
pt_2 = Point(midpt)

multiplication = Multiplication(A=panel_5, B=100)
bang = ExplodeTree(Data=partition)  # -> Branch0, Branch1, Branch2
number = Number(multiplication)
number_2 = Number(multiplication)

# ----
# DEFINE KARAMBA ELEMENTS
panel_11 = Panel("wood")
division_2 = Division(A="1050", B="3")
matprops = MaterialPropertiesKaramba3D(
    FamilyOfMaterial=panel_11,
    Name="poplar",
    YoungsModulus_kN_cm2="1050",
    InPlaneShearModulus_kN_cm2=division_2,
    TransverseShearModulus_kN_cm2=division_2,
    SpecificWeight_kN_m3="6",
    CoefficientOfThermalExpansion_1_C=1e-05,
    YieldStrength_kN_cm2=23.5,
    mode="Isotrop")
material = MaterialKaramba3D(matprops)
material_2 = MaterialKaramba3D(material)
cross_section = CrossSectionKaramba3D(
    FamilyNameOfCrossSection="DefaultCroSec",
    Material=material_2,
    Height_cm=number,
    UpperFlangeWidth_cm=number_2,
    LowerFlangeWidth_cm=number_2,
    mode="Trapezoid")
crosec = CrossSectionKaramba3D(cross_section)

python_7 = GhPythonScript(
    spring_translational_stiffness="0",
    spring_rotational_stiffness="0",
    has_translation_spring=Toggle(True),
    has_rotation_spring=Toggle(True))  # -> out, ct, cr, dof; inputs has_translation_spring: Boolean, has_rotation_spring: Boolean
# ---------- python_7: Python ----------
import rhinoscriptsyntax as rs

dof = []

if has_translation_spring:
    dof.extend(list(range(0, 3)))
if has_rotation_spring:
    dof.extend(list(range(3, 6)))


tras = spring_translational_stiffness
rots = spring_rotational_stiffness

ct = rs.AddPoint(tras, tras, tras)
cr = rs.AddPoint(rots, rots, rots)
# ---------- end python_7 ----------
crv_6 = Curve(bang.Branch0)
crv_7 = Curve(bang.Branch1)
crv_8 = Curve(bang.Branch2)
python_8 = GhPythonScript()  # -> ele_sup_start, ele_norm, ele_sup_end
# ---------- python_8: Python ----------
ele_sup_start = []
for i in range(3):
    ele_sup_start.append("{}_sup".format(i))
    
ele_sup_end = []
for i in range(42,45):
    ele_sup_end.append("{}_sup".format(i))
    

#ele_norm = []
#for i in range(3,42):
#    ele_norm.append("{}_norm".format(i))
    
ele_norm = []
for i in range(3,42):
    ele_norm.append("{}_norm_1".format(i))
    ele_norm.append("{}_norm_2".format(i))
    
print ele_norm
# ---------- end python_8 ----------
txt = Text(python_8.ele_norm)
item_4 = ListItem(List=pt, Index=0, Wrap=True)  # -> Item1, Item
divide = DivideCurve(Curve=crv_7, Count=2, Kinks=False)  # -> Points, Tangents, Parameters
dispatch = Dispatch(List=txt, DispatchPattern=[True, False])  # -> ListA, ListB
pt_3 = Point(pt)
vec = Vector(python_7.cr)
pt_4 = Point(item_4.Item)
pt_5 = Point(item_4.Item1)
vec_2 = Vector(python_7.ct)
int = Integer(python_7.dof)
midpt_2 = CurveMiddle(Curve=crv_7)
shatter = Shatter(Curve=graft(crv_7), Parameters=divide.Parameters)
item_5 = ListItem(List=midpt_2, Index=Slider(18, range=0..20), Wrap=True)
panel_12 = Panel(dispatch.ListA)
panel_13 = Panel(dispatch.ListB)
crv_9 = Curve(crv_6)
crv_10 = Curve(crv_8)
crv_11 = Curve(shatter)
pt_6 = Point(pt_3)
pt_7 = Point(item_5)
vec_3 = Vector(vec_2)
vec_4 = Vector(vec)
int_2 = Integer(int)
Z = UnitZ(Factor="-0.01")
pt_8 = Point(midpt_2)
pt_9 = Point(pt_4)
pt_10 = Point(pt_5)
Z_2 = UnitZ(Factor="-1")
graft = GraftTree(Tree=crv_9, IncludeEmptyLists=True, IncludeNullItems=True)
graft_2 = GraftTree(Tree=python_8.ele_sup_start, IncludeEmptyLists=True, IncludeNullItems=True)
graft_3 = GraftTree(Tree=crv_11, IncludeEmptyLists=True, IncludeNullItems=True)
graft_4 = GraftTree(Tree=python_8.ele_norm, IncludeEmptyLists=True, IncludeNullItems=True)
graft_5 = GraftTree(Tree=crv_10, IncludeEmptyLists=True, IncludeNullItems=True)
graft_6 = GraftTree(Tree=python_8.ele_sup_end, IncludeEmptyLists=True, IncludeNullItems=True)
crosec_2 = CrossSectionKaramba3D(crosec)
crosec_3 = CrossSectionKaramba3D(crosec)
crosec_4 = CrossSectionKaramba3D(crosec)
beam_joints = BeamJointsKaramba3D(
    ElementIdentifiers=panel_13,
    CtKNMAtStartingNode=Vector(0, 0, 0),
    CrKNmRadAtStartingNode=Vector(0, 0, 0),
    CtKNMAtEndNode=Vector(0, 0, 0),
    CrKNmRadAtEndNode=Vector(0, 0, 0),
    menu=[buttons(off, off, off, off, off, off), buttons(off, off, off, off, on, on)])
beam_joints_2 = BeamJointsKaramba3D(
    ElementIdentifiers=panel_12,
    CtKNMAtStartingNode=Vector(0, 0, 0),
    CrKNmRadAtStartingNode=Vector(0, 0, 0),
    CtKNMAtEndNode=Vector(0, 0, 0),
    CrKNmRadAtEndNode=Vector(0, 0, 0),
    menu=[buttons(off, off, off, off, on, on), buttons(off, off, off, off, off, off)])
joint_agent = BeamJointAgentKaramba3D(ToGeometry=pt_7, Ct_kN_m=vec_3, Cr_kNm_rad=vec_4, Dofs=int_2, menu=[buttons(on, on, on, off, off, off)])
supp = SupportKaramba3D(PosInd=pt_9, menu=[buttons(on, on, on, on, on, on)])
supp_2 = SupportKaramba3D(PosInd=pt_10, menu=[buttons(on, on, on, on, off, off)])
supp_3 = SupportKaramba3D(PosInd=pt_8, menu=[buttons(on, on, on, on, on, on)])
linetobeam = LineToBeamKaramba3D(Line=graft, Identifier=graft_2, CrossSection=crosec_2, New=True, Remove=True, LimitDistance_m=0.005)  # -> simplify(Element), Points, Info
linetobeam_2 = LineToBeamKaramba3D(
    Line=graft_3,
    Identifier=graft_4,
    CrossSection=crosec_4,
    New=True,
    Remove=True,
    LimitDistance_m=0.005,
    Bending=Toggle(True))  # -> simplify(Element), Points, Info
linetobeam_3 = LineToBeamKaramba3D(Line=graft_5, Identifier=graft_6, CrossSection=crosec_3, New=True, Remove=True, LimitDistance_m=0.005)  # -> simplify(Element), Points, Info
loads = LoadsKaramba3D(Vector=Vector(0, 0, -1), LCase=0, mode="Gravity")
loads_2 = LoadsKaramba3D(ForceVector=Z, Local=False, PosInd=pt_6, LCase=0, mode="Point")
loads_3 = LoadsKaramba3D(ForceVector=Z_2, Local=False, PosInd=item_5, LCase=0, mode="Point")  # disabled
merge = Merge(Data1=loads, Data2=loads_2, Data3=loads_3)
joint = JointKaramba3D(beam_joints_2)
joint_2 = JointKaramba3D(beam_joints)
joint_3 = JointKaramba3D(joint_agent)
entwine = Entwine(Branch00=linetobeam.Element, Branch01=linetobeam_2.Element, Branch02=linetobeam_3.Element, FlattenInputs=True)
support = SupportKaramba3D([supp_2, supp])
merge_2 = Merge(Data1=joint, Data2=joint_2)
panel_14 = Panel(joint_2)
panel_15 = Panel(joint_3)
load = LoadKaramba3D(merge)
element = ElementKaramba3D(simplify(flatten(entwine)))
joint_4 = JointKaramba3D(merge_2)

load_2 = LoadKaramba3D(flatten(load))
element_2 = ElementKaramba3D(element)
support_2 = SupportKaramba3D(support)
assemble = AssembleModelKaramba3D(Elem=flatten(element_2), Support=flatten(support_2), Load=flatten(load_2), Joint=flatten(joint_4), LimitDistance_m=0.005)  # -> Model, Info, Mass_kg, CenterOfGravity
analyze = AnalyzeKaramba3D(Model=assemble.Model)  # -> CalculatedModel, MaximumDisplacement_cm, ResultingForceOfGravity_kN, ElasticEnergy_kNm
num_8 = Number(analyze.MaximumDisplacement_cm)
model = ModelKaramba3D(analyze.CalculatedModel)
panel_16 = Panel(num_8)

disassemble = DisassembleElementKaramba3D(Element=element_2)  # -> Element, ElementIdentifier, AxisOfElement, CrossSection, Joints, Material, LocalCoordinateSystem, ElementIsActive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
num_9 = Number(analyze.ElasticEnergy_kNm)

panel_17 = Panel(num_9)

model_2 = ModelKaramba3D(model)
b_res_force = BeamResultantForcesKaramba3D(AnalyzedModel=model_2, LoadCase=-1, MaximumProbingDistance_m=-1, NumberOfProbingPointsPerElement=3)  # -> AnalyzedModel, NormalForce_kN, ResultantBendingMoment_kNm, ResultantShearForce_kN
txt_2 = Text(disassemble.ElementIdentifier)
num_10 = Number(b_res_force.NormalForce_kN)
python_9 = GhPythonScript(forces=num_10, ids=txt_2)  # -> member_forces, sorted_forces; inputs forces: list, ids: list
# ---------- python_9: Python ----------
import operator

member_forces = {}
for f,id in zip(forces,ids):
    member_forces[id] = f

sorted_forces = sorted(member_forces.items(), key=lambda k:abs(k[1]))

print sorted_forces
member_forces = [member_forces]
# ---------- end python_9 ----------
python_10 = GhPythonScript(sorted_forces=python_9.sorted_forces, amount=Slider(0, range=0..10))  # -> out, min_value, min_name; inputs sorted_forces: list, amount: Int32
# ---------- python_10: Python ----------
min_value = []
min_name = []

for i in range(amount):
    min_name.append(sorted_forces[i][0])
    min_value.append(sorted_forces[i][1])

print min_value
print min_name
# ---------- end python_10 ----------
python_11 = GhPythonScript(min_name=python_10.min_name)  # -> out, min_index; inputs min_name: list
# ---------- python_11: Python ----------
min_index = []

print min_name

for name in min_name:
    min_index.append( int(name.split('_')[0]))

print min_index
# ---------- end python_11 ----------
panel_18 = Panel(python_10.min_name)
num_11 = Number(python_11.min_index)
panel_19 = Panel(python_10.min_value)
panel_20 = Panel(num_11)

num_12 = Number(num_11)
python_12 = GhPythonScript(x=crv_5, off_idx=num_12)  # -> out, on_list; inputs x: list, off_idx: list of Int32
# ---------- python_12: Python ----------
num = len(x)

on_list = []
for i in range(num):
    on_list.append(True)
    
for idx in off_idx:
    on_list[idx] = False
    
print on_list
# ---------- end python_12 ----------
model_3 = ModelKaramba3D(model)
modelview = ModelViewKaramba3D(Model=model_3, ResultFactors="1000", ResultCase=-1)  # -> Model, DeformedMesh, DeformedAxes, DeformedModel; disabled
beamview = BeamViewKaramba3D(Model=modelview.Model)  # -> Model, MeshesOfRenderedBeams, DeformedBeamAxes, LegendColors, LegendTags; disabled
legend = Legend(Colour=beamview.LegendColors, Tags=beamview.LegendTags, LegendType=101)
txt_3 = Text(disassemble.ElementIdentifier)
panel_21 = Panel(python_9.sorted_forces)

activate = ElementActivationKaramba3D(Model=assemble.Model, IsActive=python_12.on_list)
analyze_2 = AnalyzeKaramba3D(Model=activate)  # -> CalculatedModel, MaximumDisplacement_cm, ResultingForceOfGravity_kN, ElasticEnergy_kNm
num_13 = Number(analyze_2.MaximumDisplacement_cm)
panel_22 = Panel(num_13)

ladeform = LargeDeformationAnalysisKaramba3D(Model=activate, Increments=5, MaximumDisplacement_m=-1)  # -> CalculatedModel, MaximumDisplacement_cm
emodes = EigenModesKaramba3D(Model=activate, FromIndex=Slider(1, range=1..10), NumberOfModes=1, MaximumNumberOfIterations=300, Epsilon=1e-07)  # -> ModelWithEigenModesAsLoadCaseResults, Eigenvalues
analyzenonlin_wip = AnalyzeNonlinearWIPKaramba3D(
    Model=activate,
    NumberOfLoadSteps=1,
    InitialLoadFactor=0.2,
    MaxNumberOfEquilibriumIterations=50,
    TargetNumberOfEquilibriumIterations=10,
    EquilibriumTolerance=1e-07,
    MaxNumberOfLoadIncrements=30,
    mode="ArcLength")  # -> CalculatedModel, MaximumDisplacement_cm, ElasticEnergy_kNm, Info, Lambdas
model_4 = ModelKaramba3D(analyze_2.CalculatedModel)
num_14 = Number(analyze_2.ElasticEnergy_kNm)

panel_23 = Panel(num_14)

model_5 = ModelKaramba3D(model_4)
b_res_force_2 = BeamResultantForcesKaramba3D(AnalyzedModel=model_5, LoadCase=-1, MaximumProbingDistance_m=-1, NumberOfProbingPointsPerElement=3)  # -> AnalyzedModel, NormalForce_kN, ResultantBendingMoment_kNm, ResultantShearForce_kN
num_15 = Number(b_res_force_2.NormalForce_kN)
txt_4 = Text(disassemble.ElementIdentifier)
python_13 = GhPythonScript(forces=num_15, ids=txt_4)  # -> member_forces, sorted_forces; inputs forces: list, ids: list; same code as python_9
python_14 = GhPythonScript(sorted_forces=python_13.sorted_forces, amount="6")  # -> out, min_value, min_name; inputs sorted_forces: list, amount: Int32; same code as python_10
python_15 = GhPythonScript(min_name=python_14.min_name)  # -> out, min_index; inputs min_name: list; same code as python_11
panel_24 = Panel(python_14.min_name)
num_16 = Number(python_15.min_index)
panel_25 = Panel(python_14.min_value)
panel_26 = Panel(num_16)

model_6 = ModelKaramba3D(model_4)
modelview_2 = ModelViewKaramba3D(Model=model_6, ResultFactors="1", ResultCase=-1)  # -> Model, DeformedMesh, DeformedAxes, DeformedModel
beamview_2 = BeamViewKaramba3D(Model=modelview_2.Model)  # -> Model, MeshesOfRenderedBeams, DeformedBeamAxes, LegendColors, LegendTags
legend_2 = Legend(Colour=beamview_2.LegendColors, Tags=beamview_2.LegendTags, LegendType=101)
python_16 = GhPythonScript(x=python_9.member_forces, y=python_13.member_forces, ids=txt_3)  # -> sorted_change; inputs x: list, y: list, ids: list
# ---------- python_16: Python ----------
before = x[0]
after = y[0]

change = {}
for id in ids:
    diff = 100*(before[id] - after[id])/before[id]
    change[id] = diff
    


sorted_change= sorted(change.items(), key=lambda k:k[1])

print sorted_change
# ---------- end python_16 ----------
panel_27 = Panel(python_16)
# SEND ROBOT COMMANDS
panel_28 = Panel(python_13.sorted_forces)
